% Simulink data dictionary param.sldd

pid = Simulink.Parameter(struct(P=2, I=22, D=0.05, N=1000), StorageClass="SimulinkGlobal", DataType="Bus: pid_param")

pid_param = Simulink.Bus()
  P: double
  I: double
  D: double
  N: double

dead_zone_end = Simulink.Parameter(repmat(0.5, 6, 1), StorageClass="GetSet", GetFunction="get_$N", SetFunction="set_$N", DataType="double")
saturation_upper_limit = Simulink.Parameter(repmat(100, 6, 1), StorageClass="GetSet", GetFunction="get_$N", SetFunction="set_$N", DataType="double")
saturation_lower_limit = Simulink.Parameter(repmat(-100, 6, 1), StorageClass="GetSet", GetFunction="get_$N", SetFunction="set_$N", DataType="double")
T_sample_control = 0.008
filter_num = Simulink.Parameter([0.7951999 0.1868726 0.4897644], StorageClass="GetSet", GetFunction="get_$N", SetFunction="set_$N", DataType="double")
filter_den = Simulink.Parameter([1 0.3815585 0.7655168], StorageClass="GetSet", GetFunction="get_$N", SetFunction="set_$N", DataType="double")
N = Simulink.Parameter(repmat(0, 1, 6), StorageClass="GetSet", GetFunction="get_$N", SetFunction="set_$N", DataType="double")
D = Simulink.Parameter(repmat(0, 1, 6), StorageClass="GetSet", GetFunction="get_$N", SetFunction="set_$N", DataType="double")
I = Simulink.Parameter(repmat(0, 1, 6), StorageClass="GetSet", GetFunction="get_$N", SetFunction="set_$N", DataType="double")
P = Simulink.Parameter(repmat(1, 1, 6), StorageClass="GetSet", GetFunction="get_$N", SetFunction="set_$N", DataType="double")
dead_zone_start = Simulink.Parameter(repmat(-0.5, 6, 1), StorageClass="GetSet", GetFunction="get_$N", SetFunction="set_$N", DataType="double")
force_error = Simulink.Signal(StorageClass="ExportedGlobal", GetFunction="get_$N", SetFunction="set_$N", DataType="double", Dimensions=6, InitialValue="zeros(6,1)")
force_filter = Simulink.Signal(StorageClass="ExportedGlobal", GetFunction="get_$N", SetFunction="set_$N", DataType="double", Dimensions=6, InitialValue="zeros(6,1)")