% Simulink data dictionary param.sldd

pid_param = Simulink.Bus()
  P: double
  I: double
  D: double
  N: double

T_sample_control = 0.008
filter_num = Simulink.Parameter([0 0.1], StorageClass="ExportedGlobal", DataType="double")
filter_den = Simulink.Parameter([1 -0.9], StorageClass="ExportedGlobal", DataType="double")
dead_zone_start = Simulink.Parameter(-1, StorageClass="ExportedGlobal", DataType="double")
dead_zone_end = Simulink.Parameter(1, StorageClass="ExportedGlobal", DataType="double")
saturation_lower_limit = Simulink.Parameter(-100, StorageClass="ExportedGlobal", DataType="double")
saturation_upper_limit = Simulink.Parameter(100, StorageClass="ExportedGlobal", DataType="double")
I = Simulink.Parameter(1, StorageClass="ExportedGlobal", Alias="PID_I", DataType="double")
D = Simulink.Parameter(0, StorageClass="ExportedGlobal", Alias="PID_D", DataType="double")
N = Simulink.Parameter(0, StorageClass="ExportedGlobal", Alias="PID_N", DataType="double")
P = Simulink.Parameter(10, StorageClass="ExportedGlobal", Alias="PID_P", DataType="double")
K_lamuda = Simulink.Parameter(0.02, StorageClass="ExportedGlobal", DataType="double")
force_filter = Simulink.Signal(StorageClass="ExportedGlobal", DataType="double", InitialValue="0")
force_error = Simulink.Signal(StorageClass="ExportedGlobal", DataType="double", InitialValue="0")
CV = Simulink.Signal(StorageClass="ExportedGlobal", DataType="double", InitialValue="0")